# Dynamo graph script.dyn "Test_Manual_Run_script" (Dynamo 4.0.2.3852)

string = StringInput("This message confirms that dynami works")

# group: Attach this node to the end of your script to get a balloon notification when it is done
header_text = CodeBlock { "PyRevit Notification"; }
balloon_text = CodeBlock { "Manual Mode"; }
last_script_node = CodeBlock(Code=string) { Input = Code; }
balloon_notification = Python(IN[0]=header_text, IN[1]=balloon_text, IN[2]=last_script_node)  # CPython3
# ---------- balloon_notification.python (53 lines) ----------
import datetime, os
root = os.path.join(os.environ.get('TEMP', os.environ.get('TMP', '/tmp')), 'pyrevit-headless-proof', '2024')
os.makedirs(root, exist_ok=True)
log = os.path.join(root, 'headless-auto.log')
stamp = datetime.datetime.now().strftime('%H:%M:%S.%f')[:-3]
with open(log, 'a') as marker_file:
    marker_file.write(stamp + ' graph ran' + os.linesep)

import traceback
import clr
clr.AddReference('RevitAPI')
clr.AddReference('RevitServices')
from Autodesk.Revit.DB import (BuiltInCategory, DirectShape, DirectShapeExtrusionMode,
    DirectShapeOptions, ElementTransformUtils, FilteredElementCollector, TextBoundingBox,
    TextCurve, View3D, XYZ)
from RevitServices.Persistence import DocumentManager
from RevitServices.Transactions import TransactionManager

NAME = 'pyRevit headless proof 2024'
label = 'HEADLESS 2024  ' + stamp
error_log = os.path.join(root, 'headless-auto-error.log')
doc = DocumentManager.Instance.CurrentDBDocument
uidoc = DocumentManager.Instance.CurrentUIDocument
view = uidoc.ActiveView

# A headless run swallows node exceptions, so a throw in the model step used to look
        
try:
    TransactionManager.Instance.EnsureInTransaction(doc)
    try:
        for existing in FilteredElementCollector(doc).OfCategory(BuiltInCategory.OST_DirectShapes).WhereElementIsNotElementType():
            if existing.Name == NAME:
                doc.Delete(existing.Id)
        box = TextBoundingBox()
        box.Width = 6.0
        text = TextCurve.Create(label, box)
        options = DirectShapeOptions()
        options.ExtrusionMode = DirectShapeExtrusionMode.Text
        shape = DirectShape.CreateElement(doc, text)
        shape.Name = NAME
        z = 0.0
        level = getattr(view, 'AssociatedLevel', None)
        if level is not None:
            z = level.Elevation
        x, y = 0.0, 0.0
        if isinstance(view, View3D):
            x, y, z = view.Origin.X, view.Origin.Y, view.Origin.Z
        ElementTransformUtils.MoveElement(doc, shape.Id, XYZ(x, y, z))
    finally:
        TransactionManager.Instance.TransactionTaskDone()
except Exception:
    with open(error_log, 'a') as err:
        err.write(stamp + ' model step failed' + os.linesep + traceback.format_exc())
# ----------------------------------------
