# Dynamo graph script.dyn "Test_Manual_Run_script" (Dynamo 4.0.2.3852)

string = StringInput("This message confirms that dynami works")

# group: Attach this node to the end of your script to get a balloon notification when it is done
header_text = CodeBlock { "PyRevit Notification"; }
balloon_text = CodeBlock { "Manual Mode"; }
last_script_node = CodeBlock(Code=string) { Input = Code; }
balloon_notification = Python(IN[0]=header_text, IN[1]=balloon_text, IN[2]=last_script_node)  # PythonNet3
# ---------- balloon_notification.python (43 lines) ----------
import clr
from System import DateTime, Environment
from System.IO import Directory, File, Path
root = Path.Combine(Path.GetTempPath(), 'pyrevit-headless-proof', '2027')
Directory.CreateDirectory(root)
log = Path.Combine(root, 'headless-auto.log')
stamp = DateTime.Now.ToString('HH:mm:ss.fff')
File.AppendAllText(log, stamp + ' graph ran' + Environment.NewLine)

clr.AddReference('RevitAPI')
clr.AddReference('RevitServices')
from Autodesk.Revit.DB import BuiltInCategory, DirectShape, DirectShapeExtrusionMode, DirectShapeOptions, ElementTransformUtils, FilteredElementCollector, TextBoundingBox, TextCurve, View3D, XYZ
from RevitServices.Persistence import DocumentManager
from RevitServices.Transactions import TransactionManager

NAME = 'pyRevit headless proof 2027'
label = 'HEADLESS 2027  ' + stamp
doc = DocumentManager.Instance.CurrentDBDocument
uidoc = DocumentManager.Instance.CurrentUIDocument
view = uidoc.ActiveView

TransactionManager.Instance.EnsureInTransaction(doc)
try:
    for existing in FilteredElementCollector(doc).OfCategory(BuiltInCategory.OST_DirectShapes).WhereElementIsNotElementType():
        if existing.Name == NAME:
            doc.Delete(existing.Id)
    box = TextBoundingBox()
    box.Width = 6.0
    text = TextCurve.Create(label, box)
    options = DirectShapeOptions()
    options.ExtrusionMode = DirectShapeExtrusionMode.Text
    shape = DirectShape.CreateElement(doc, text)
    shape.Name = NAME
    z = 0.0
    level = getattr(view, 'AssociatedLevel', None)
    if level is not None:
        z = level.Elevation
    x, y = 0.0, 0.0
    if isinstance(view, View3D):
        x, y, z = view.Origin.X, view.Origin.Y, view.Origin.Z
    ElementTransformUtils.MoveElement(doc, shape.Id, XYZ(x, y, z))
finally:
    TransactionManager.Instance.TransactionTaskDone()
# ----------------------------------------
