# Dynamo graph script.dyn (Dynamo 4.2.1.5887)

balloon_notification = Python()  # PythonNet3; unwired: IN[0]
# ---------- balloon_notification.python (269 lines) ----------
import clr
import os
import subprocess
import traceback
from datetime import datetime

# --------------------------------------------------
# Revit API
# --------------------------------------------------

clr.AddReference("RevitAPI")
from Autodesk.Revit.DB import *

# Dynamo / Revit services
clr.AddReference("RevitServices")
from RevitServices.Persistence import DocumentManager

# --------------------------------------------------
# Configuration
# --------------------------------------------------

folder = r"C:\Temp"

if not os.path.exists(folder):
    os.makedirs(folder)

now = datetime.now()

timestamp_text = now.strftime("%Y-%m-%d %H:%M:%S")
timestamp_filename = now.strftime("%Y-%m-%d_%H-%M-%S")

doc = None
transaction = None
revit_version = "UNKNOWN"
revit_version_name = "UNKNOWN"

try:
    # --------------------------------------------------
    # Get current Revit document
    # --------------------------------------------------

    doc = DocumentManager.Instance.CurrentDBDocument

    if doc is None:
        raise Exception("No active Revit document was found.")

    # --------------------------------------------------
    # Get actual Revit version from Revit API
    # --------------------------------------------------

    revit_version = doc.Application.VersionNumber
    revit_version_name = doc.Application.VersionName

    # --------------------------------------------------
    # Get wall type
    # --------------------------------------------------

    wall_type = (
        FilteredElementCollector(doc)
        .OfClass(WallType)
        .FirstElement()
    )

    if wall_type is None:
        raise Exception("No WallType was found in the current document.")

    # --------------------------------------------------
    # Get level
    # --------------------------------------------------

    level = (
        FilteredElementCollector(doc)
        .OfClass(Level)
        .FirstElement()
    )

    if level is None:
        raise Exception("No Level was found in the current document.")

    # --------------------------------------------------
    # Wall dimensions
    # Revit internal units are feet
    # --------------------------------------------------

    height = 10.0

    # Wall 1
    p1 = XYZ(0, 0, 0)
    p2 = XYZ(20, 0, 0)

    # Wall 2
    p3 = XYZ(0, 10, 0)
    p4 = XYZ(20, 10, 0)

    line1 = Line.CreateBound(p1, p2)
    line2 = Line.CreateBound(p3, p4)

    # --------------------------------------------------
    # Create walls
    # --------------------------------------------------

    transaction = Transaction(doc, "Dynamo Wall Test")
    transaction.Start()

    wall1 = Wall.Create(
        doc,
        line1,
        wall_type.Id,
        level.Id,
        height,
        0.0,
        False,
        False
    )

    wall2 = Wall.Create(
        doc,
        line2,
        wall_type.Id,
        level.Id,
        height,
        0.0,
        False,
        False
    )

    transaction.Commit()
    transaction = None

    # --------------------------------------------------
    # Create success marker file
    # --------------------------------------------------

    filename = "Dynamo_Wall_Test_{}_SUCCESS_{}.txt".format(
        revit_version,
        timestamp_filename
    )

    marker_path = os.path.join(folder, filename)

    # --------------------------------------------------
    # Get ElementIds
    # --------------------------------------------------

    wall1_id = wall1.Id.Value
    wall2_id = wall2.Id.Value

    # --------------------------------------------------
    # Write success marker
    # --------------------------------------------------

    with open(marker_path, "w") as f:
        f.write("DYNAMO WALL TEST SUCCESSFUL\n")
        f.write("=" * 60)
        f.write("\n\n")

        f.write("Execution date and time: {}\n".format(timestamp_text))
        f.write("Revit version: {}\n".format(revit_version))
        f.write("Revit version name: {}\n".format(revit_version_name))
        f.write("Revit document: {}\n".format(doc.Title))

        f.write("\n")
        f.write("RESULT:\n")
        f.write("Walls created: 2\n")
        f.write("Wall 1 ElementId: {}\n".format(wall1_id))
        f.write("Wall 2 ElementId: {}\n".format(wall2_id))

        f.write("\n")
        f.write("Marker file: {}\n".format(marker_path))

    # --------------------------------------------------
    # Open success file in Notepad
    # --------------------------------------------------

    subprocess.Popen(["notepad.exe", marker_path])

    # --------------------------------------------------
    # Dynamo output
    # --------------------------------------------------

    OUT = [
        wall1,
        wall2,
        revit_version,
        timestamp_text,
        marker_path
    ]

except Exception as ex:

    # --------------------------------------------------
    # Roll back transaction if something failed
    # --------------------------------------------------

    if transaction is not None:
        try:
            if transaction.GetStatus() == TransactionStatus.Started:
                transaction.RollBack()
        except:
            pass

    # --------------------------------------------------
    # Try to retrieve Revit version if possible
    # --------------------------------------------------

    if doc is not None:
        try:
            revit_version = doc.Application.VersionNumber
            revit_version_name = doc.Application.VersionName
        except:
            pass

    # --------------------------------------------------
    # Create error log
    # --------------------------------------------------

    error_filename = "Dynamo_Wall_Test_{}_ERROR_{}.txt".format(
        revit_version,
        timestamp_filename
    )

    error_path = os.path.join(folder, error_filename)

    error_trace = traceback.format_exc()

    with open(error_path, "w") as f:
        f.write("DYNAMO WALL TEST FAILED\n")
        f.write("=" * 60)
        f.write("\n\n")

        f.write("Execution date and time: {}\n".format(timestamp_text))
        f.write("Revit version: {}\n".format(revit_version))
        f.write("Revit version name: {}\n".format(revit_version_name))

        if doc is not None:
            try:
                f.write("Revit document: {}\n".format(doc.Title))
            except:
                pass

        f.write("\n")
        f.write("ERROR:\n")
        f.write(str(ex))
        f.write("\n\n")

        f.write("FULL STACK TRACE:\n")
        f.write("-" * 60)
        f.write("\n")
        f.write(error_trace)
        f.write("\n")

        f.write("-" * 60)
        f.write("\n")
        f.write("Error log: {}\n".format(error_path))

    # --------------------------------------------------
    # Open error file in Notepad
    # --------------------------------------------------

    try:
        subprocess.Popen(["notepad.exe", error_path])
    except:
        pass

    # --------------------------------------------------
    # Still report the run as failed in Dynamo
    # --------------------------------------------------

    raise
# ----------------------------------------
