# Dynamo graph script.dyn (Dynamo 4.2.1.5887)

should_not_run = Python()  # PythonNet3; unwired: IN[0]
# ---------- should_not_run.python (21 lines) ----------
import os
from datetime import datetime

folder = r"C:\Temp"
if not os.path.exists(folder):
    os.makedirs(folder)

marker_path = os.path.join(
    folder,
    "Dynamo_Forced_Manual_SHOULD_NOT_RUN_{}.txt".format(
        datetime.now().strftime("%Y-%m-%d_%H-%M-%S")
    ),
)

with open(marker_path, "w") as f:
    f.write(
        "This graph is saved on Automatic run but the bundle forces it to Manual. A headless "
        "automation run from pyRevit must report it as not run and never execute it."
    )

OUT = marker_path
# ----------------------------------------
