# Dynamo graph config.dyn (Dynamo 2.0.3.8810)

categories = Categories(index=585)
current = Document.Current()
activeView = Document.ActiveView(document=current)
byCategoryAndView = archilab.Revit.Selection.Select.ByCategoryAndView(category=categories, view=activeView)
watch = Watch(byCategoryAndView)
text = TextNote.Text(textNote=byCategoryAndView)
toUpper = String.ToUpper(str=text)
setText = TextNote.SetText(textNote=watch, value=toUpper)
