# Dynamo graph Test_Manual_Run_script.dyn (Dynamo 2.19.3.6394)

string = StringInput("This message confirms that dynami works")

# group: Attach this node to the end of your script to get a balloon notification when it is done
header_text = CodeBlock { "PyRevit Notification"; }
balloon_text = CodeBlock { "Manual Mode"; }
last_script_node = CodeBlock(Code=string) { Input = Code; }
balloon_notification = Python(IN[0]=header_text, IN[1]=balloon_text, IN[2]=last_script_node)  # CPython3
# ---------- balloon_notification.python (43 lines) ----------
import clr
clr.AddReference('AdWindows')
from System import AppDomain, Array, Object, Type

adw = None
for a in AppDomain.CurrentDomain.GetAssemblies():
    if 'AdWindows' in str(a.FullName):
        adw = a
        break

RIType = adw.GetType('Autodesk.Internal.InfoCenter.ResultItem')
CMType = adw.GetType('Autodesk.Windows.ComponentManager')
empty = Array.CreateInstance(Object, 0)

def make_ri(clr_type):
    for c in clr_type.GetConstructors():
        if len(c.GetParameters()) == 0:
            return c.Invoke(empty)

def balloon(hdr, txt, tip='', grp='', fav=False, new=False):
    ri = make_ri(RIType)
    ri.Category = hdr
    ri.Title = txt
    ri.TooltipText = tip
    ri.Group = grp
    ri.IsFavorite = fav
    ri.IsNew = new
    # NOTE: ResultClicked += handler is skipped on CPython3
    # due to System.Reflection.Emit.TypeBuilder bug in PythonNet 2.5.2
    # Use IronPython2 or PythonNet3 if click handling is needed
    pp = CMType.GetProperty('InfoCenterPaletteManager')
    pm = pp.GetValue(None)
    pt = Array.CreateInstance(Type, 1)
    pt[0] = RIType
    m = pm.GetType().GetMethod('ShowBalloon', pt)
    ar = Array.CreateInstance(Object, 1)
    ar[0] = ri
    return m.Invoke(pm, ar)

h = 'header' if IN[0] is None else IN[0]
t = 'Mission Accomplished' if IN[1] is None else IN[1]
if IN[2]:
    balloon(h, t, 'tooltip', 'group', True, True)
# ----------------------------------------

watch = Watch(balloon_notification)
