# Grasshopper definition script.gh (Grasshopper 1.0.8)
# Copyright: tayothman.com

py3 = Python3Script(Run=Toggle(True))  # -> out, a; inputs Run: Boolean
# ---------- py3: Python ----------
#! python 3
import Rhino.UI
import Eto.Forms as forms
import Eto.Drawing as drawing

class RIRTestDialog(forms.Dialog[bool]):
    def __init__(self):
        # 1. Initialize the underlying .NET base class first
        super().__init__()
        
        self.Title = "pyRevit Bundle Test"
        self.Padding = drawing.Padding(20)
        self.Resizable = False

        # 2. CRUCIAL FIX: Instantiate the control, THEN assign properties.
        self.label = forms.Label()
        self.label.Text = "Rhino Inside Revit is Functioning Properly"
        
        self.ok_button = forms.Button()
        self.ok_button.Text = "OK"
        self.ok_button.Click += self.OnOkButtonClick

        # 3. Build the layout
        layout = forms.DynamicLayout()
        layout.Spacing = drawing.Size(10, 10)
        layout.AddRow(self.label)
        layout.AddRow(None) # Spacer
        layout.AddRow(self.ok_button)

        self.Content = layout

    def OnOkButtonClick(self, sender, e):
        self.Close(True)

# 4. Execution logic tied to the Boolean Toggle
if 'Run' in globals() and Run:
    dialog = RIRTestDialog()
    dialog.ShowModal(Rhino.UI.RhinoEtoApp.MainWindow)
# ---------- end py3 ----------
